# Grasshopper definition Example move Diva Images.gh (Grasshopper 0.9.76)
# plug-ins: Python Interpreter, DIVA Daylight

toggle = BooleanToggle(False)
number_slider = Slider(6, range=6..12)
number_slider_2 = Slider(14, range=14..18)
fly = Ladybug_fly(inputSliders=[number_slider_2, number_slider])  # -> Vviiiiiiiiiizzz; plug-in component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
pt = ConstructPoint(XCoordinate="1100", YCoordinate="350", ZCoordinate="280")
pt_2 = ConstructPoint(XCoordinate="900", YCoordinate="100", ZCoordinate="280")
cam = Camera(
    XDim=400,
    YDim=400,
    BooleanValue_0=False,
    BooleanValue_1=False,
    BooleanValue_2=False,
    BooleanValue_3=False,
    BooleanValue_4=False,
    BooleanValue_5=False,
    BooleanValue_6=False,
    BooleanValue_7=False,
    BooleanValue_8=False,
    BooleanValue_9=False,
    Hidden_0=True,
    Hidden_1=False,
    Hidden_2=True,
    Hidden_3=True,
    Hidden_4=True,
    Hidden_5=True,
    Hidden_6=True,
    Hidden_7=False,
    Hidden_8=False,
    Hidden_9=True,
    IntegerValue_0=-2147483648,
    IntegerValue_1=-2147483648,
    IntegerValue_2=-2147483648,
    IntegerValue_3=-2147483648,
    IntegerValue_4=-2147483648,
    IntegerValue_5=-2147483648,
    IntegerValue_6=-2147483648,
    IntegerValue_7=400,
    IntegerValue_8=400,
    IntegerValue_9=-2147483648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)  # disabled
cam_2 = Camera(
    ViewPoint=pt,
    ViewDirection=pt_2,
    ViewUp=Vector(0, 1, 0),
    XDim=400,
    YDim=400,
    BooleanValue_0=False,
    BooleanValue_1=False,
    BooleanValue_2=False,
    BooleanValue_3=False,
    BooleanValue_4=False,
    BooleanValue_5=False,
    BooleanValue_6=False,
    BooleanValue_7=False,
    BooleanValue_8=False,
    BooleanValue_9=False,
    Hidden_0=True,
    Hidden_1=False,
    Hidden_2=False,
    Hidden_3=False,
    Hidden_4=False,
    Hidden_5=False,
    Hidden_6=True,
    Hidden_7=False,
    Hidden_8=False,
    Hidden_9=True,
    IntegerValue_0=-2147483648,
    IntegerValue_1=-2147483648,
    IntegerValue_2=-2147483648,
    IntegerValue_3=-2147483648,
    IntegerValue_4=-2147483648,
    IntegerValue_5=-2147483648,
    IntegerValue_6=-2147483648,
    IntegerValue_7=400,
    IntegerValue_8=400,
    IntegerValue_9=-2147483648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)
toggle_2 = BooleanToggle(False)
toggle_3 = BooleanToggle(False)
concat = Concatenate(FragmentA="Glare_Persp2_desk_looking SW", FragmentB=number_slider)
concat_2 = Concatenate(FragmentA=concat, FragmentB=number_slider_2)
concat_3 = Concatenate(FragmentA="Viz_Persp2_desk_looking SW", FragmentB=number_slider)
concat_4 = Concatenate(FragmentA=concat_3, FragmentB=number_slider_2)
sky = Sky(
    Month=number_slider,
    Day="21",
    Hour=number_slider_2,
    BooleanValue_0=False,
    BooleanValue_1=False,
    BooleanValue_2=False,
    BooleanValue_3=False,
    BooleanValue_4=False,
    BooleanValue_5=False,
    BooleanValue_6=False,
    BooleanValue_7=False,
    BooleanValue_8=False,
    BooleanValue_9=False,
    Hidden_0=False,
    Hidden_1=False,
    Hidden_2=False,
    Hidden_3=False,
    Hidden_4=False,
    Hidden_5=True,
    Hidden_6=True,
    Hidden_7=True,
    Hidden_8=True,
    Hidden_9=True,
    IntegerValue_0=-2147483648,
    IntegerValue_1=-2147483648,
    IntegerValue_2=6,
    IntegerValue_3=21,
    IntegerValue_4=-2147483648,
    IntegerValue_5=-2147483648,
    IntegerValue_6=-2147483648,
    IntegerValue_7=-2147483648,
    IntegerValue_8=-2147483648,
    IntegerValue_9=2016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)
glare = Glare(
    Name=concat_2,
    Camera=cam,
    RhinoScene="TRUE",
    Sky=sky,
    Run=toggle,
    BooleanValue_0=False,
    BooleanValue_1=False,
    BooleanValue_10=False,
    BooleanValue_11=False,
    BooleanValue_12=False,
    BooleanValue_13=False,
    BooleanValue_14=False,
    BooleanValue_15=False,
    BooleanValue_16=False,
    BooleanValue_17=False,
    BooleanValue_18=False,
    BooleanValue_19=False,
    BooleanValue_2=False,
    BooleanValue_20=False,
    BooleanValue_3=True,
    BooleanValue_4=False,
    BooleanValue_5=False,
    BooleanValue_6=False,
    BooleanValue_7=False,
    BooleanValue_8=True,
    BooleanValue_9=False,
    Hidden_0=False,
    Hidden_1=False,
    Hidden_10=True,
    Hidden_11=True,
    Hidden_12=True,
    Hidden_13=True,
    Hidden_14=True,
    Hidden_15=True,
    Hidden_16=True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)  # -> Out, Pic, Image, Falsecolor, Evalglare, DGP, DGR
visualization = Visualization(
    Name=concat_4,
    Camera=cam,
    RhinoScene="TRUE",
    Sky=sky,
    Run=toggle,
    BooleanValue_0=False,
    BooleanValue_1=False,
    BooleanValue_10=False,
    BooleanValue_11=False,
    BooleanValue_12=False,
    BooleanValue_13=False,
    BooleanValue_14=False,
    BooleanValue_15=False,
    BooleanValue_16=False,
    BooleanValue_17=False,
    BooleanValue_18=False,
    BooleanValue_19=False,
    BooleanValue_2=False,
    BooleanValue_20=False,
    BooleanValue_21=False,
    BooleanValue_3=True,
    BooleanValue_4=False,
    BooleanValue_5=False,
    BooleanValue_6=False,
    BooleanValue_7=False,
    BooleanValue_8=True,
    BooleanValue_9=False,
    Hidden_0=False,
    Hidden_1=False,
    Hidden_10=True,
    Hidden_11=True,
    Hidden_12=True,
    Hidden_13=True,
    Hidden_14=True,
    Hidden_15=True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)  # -> Out, Pic, Image, Falsecolor
panel = Panel(visualization.Falsecolor)
glare_2 = Glare(
    Name=concat_2,
    Camera=cam,
    RhinoScene="TRUE",
    Sky=sky,
    Run=toggle,
    BooleanValue_0=False,
    BooleanValue_1=False,
    BooleanValue_10=False,
    BooleanValue_11=False,
    BooleanValue_12=False,
    BooleanValue_13=False,
    BooleanValue_14=False,
    BooleanValue_15=False,
    BooleanValue_16=False,
    BooleanValue_17=False,
    BooleanValue_18=False,
    BooleanValue_19=False,
    BooleanValue_2=False,
    BooleanValue_20=False,
    BooleanValue_3=True,
    BooleanValue_4=False,
    BooleanValue_5=False,
    BooleanValue_6=False,
    BooleanValue_7=False,
    BooleanValue_8=True,
    BooleanValue_9=False,
    Hidden_0=False,
    Hidden_1=False,
    Hidden_10=True,
    Hidden_11=True,
    Hidden_12=True,
    Hidden_13=True,
    Hidden_14=True,
    Hidden_15=True,
    Hidden_16=True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)  # -> Out, Pic, Image, Falsecolor, Evalglare, DGP, DGR
sort_files_by_out_and_component = SortFilesByOutputAndComponent(inputFiles=flatten([visualization.Falsecolor, glare.Image, glare.Falsecolor, glare.Evalglare]))
# ---------- sort_files_by_out_and_component: Python ----------
"""
This component will sort files by their component and output node, this is useful for gathering all the images of a study in one folder to make a video

If you re-compute the computer and a file is taken away at this stage you need to delete empty folders or directories manually 

Created by Anton Szilasi - contact him for user requests or bug reports
-
Provided by Ladybug 0.0.63
    
    Args:
        inputFiles_: Connect all the file path inputs that you would like to be sorted
        _moveToFolder: Name a root directory where you would like all the sorted files to be placed
    Returns:
        fileLocations: ...
"""

ghenv.Component.Name = "Sort files by output and component"
ghenv.Component.NickName = 'Sort files by out and component'

import os
import Grasshopper
import Grasshopper.Kernel as gh
import ctypes.wintypes
import shutil

class myDictSet(dict):

    def __init__(self):
        self = dict()
    
    def add(self, key, value):
        
        if key in self.keys():
            
            self[key].add(value)
        
        else:
            # Create key
            self[key] = set()
            self[key].add(value)
            

class AutoVivification(dict):
    #Implementation of perl's autovivification feature
    def __getitem__(self, item):
        try:
            return dict.__getitem__(self, item)
        except KeyError:
            value = self[item] = type(self)()
            return value
            
def myprint(d):
  for k, v in d.iteritems():
    if isinstance(v, dict):
      myprint(v)
    else:
      print "{0} : {1}".format(k, v)
      
      
CSIDL_PERSONAL= inputFiles_  # My Documents
SHGFP_TYPE_CURRENT= 0   # Want current, not default value

buf = ctypes.create_unicode_buffer(ctypes.wintypes.MAX_PATH)

ctypes.windll.shell32.SHGetFolderPathW(0, CSIDL_PERSONAL, 0, SHGFP_TYPE_CURRENT, buf)

checkDuplicateComponents = myDictSet()

filePaths = AutoVivification()

for input in ghenv.Component.Params.Input:
    
    # Get the connected component of the output
    for source in input.Sources:

        attr = source.Attributes
        if (attr is None) or (attr.GetTopLevel is None):
            pass
            
        else:
            component = attr.GetTopLevel.DocObject
            
            # Check that there are not two components of the same type! 
            
            checkDuplicateComponents.add(component.ComponentGuid,component.InstanceGuid)
            
            if len(checkDuplicateComponents.get(component.ComponentGuid)) > 1:
                
                warning = "You cannot connect two components of the same type to this component!"
                print warning
                ghenv.Component.AddRuntimeMessage(gh.GH_RuntimeMessageLevel.Error, warning)
                
                break 
                
            else:
                
                filePaths[component.Name][source.NickName] = source.VolatileData[0][0]
                
                
userName = os.getenv('USERNAME')

# Make main diva output component

if _moveToFolder != None:

    try:
        outputfolder = _moveToFolder+'\\Desktop\\divaOutputs'
        os.mkdir('C:\\Users\\'+str(userName)+'\\Desktop\\divaOutputs')
        
    except OSError:
        
        pass
        
else:
    
    try:
        outputfolder = 'C:\\Users\\'+str(userName)+'\\Desktop\\divaOutputs'
        os.mkdir('C:\\Users\\'+str(userName)+'\\Desktop\\divaOutputs')
        
    except OSError:
        
        pass

# Make folders for each output on each component and move the respective files into those components
for componentNames,values in filePaths.iteritems():
    
    # Make component folders within main output component
    
    try:
        os.mkdir(outputfolder+'\\'+componentNames)
        
        # File the folders 
    except OSError:
        pass

    for componentOutputName,componentOutput in values.iteritems():
        
        # New component out directory
        
        newDir = outputfolder+'\\'+componentNames+'\\'+componentOutputName
        
        try:
            
            os.mkdir(newDir)
            
            # File the folders 
        except OSError:
            pass
            
        # Move the files
        shutil.copy(str(componentOutput),newDir)
# ---------- end sort_files_by_out_and_component ----------
python = PythonScript(x=flatten(glare.Evalglare))  # -> out, a; inputs x: list, y: list
# ---------- python: Python ----------
info = []

for input in ghenv.Component.Params.Input:

    for s in input.Sources:
        
        info.append('Input at {0} = {1}'.format(input.Name,s.NickName))
        print s.NickName

a = info
# ---------- end python ----------

# ---- group: Get user folders
desktoppath = PythonScript(x=glare.Evalglare)  # -> out, a; inputs x: Int32
# ---------- desktoppath: Python ----------
import ctypes.wintypes
CSIDL_PERSONAL= x       # My Documents
SHGFP_TYPE_CURRENT= 0   # Want current, not default value

buf = ctypes.create_unicode_buffer(ctypes.wintypes.MAX_PATH)

ctypes.windll.shell32.SHGetFolderPathW(0, CSIDL_PERSONAL, 0, SHGFP_TYPE_CURRENT, buf)

print buf.value
# ---------- end desktoppath ----------

# ----
panel_2 = Panel(desktoppath.a)
panel_3 = Panel(python.a)
daylight = AnnualDaylight(
    Name="Temp",
    Grids=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,
    RhinoScene=False,
    Run=False,
    BooleanValue_0=False,
    BooleanValue_1=False,
    BooleanValue_10=False,
    BooleanValue_11=False,
    BooleanValue_12=False,
    BooleanValue_13=False,
    BooleanValue_14=False,
    BooleanValue_2=False,
    BooleanValue_3=False,
    BooleanValue_4=False,
    BooleanValue_5=False,
    BooleanValue_6=False,
    BooleanValue_7=False,
    BooleanValue_8=False,
    BooleanValue_9=False,
    Hidden_0=False,
    Hidden_1=False,
    Hidden_10=True,
    Hidden_11=True,
    Hidden_12=True,
    Hidden_13=True,
    Hidden_14=False,
    Hidden_2=False,
    Hidden_3=False,
    Hidden_4=False,
    Hidden_5=False,
    Hidden_6=True,
    Hidden_7=False,
    Hidden_8=True,
    Hidden_9=True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)  # -> Out, SDA, ASE, LEEDv4, LightingEnergy, OpenPercentage, Windows, Grids, Zones
glare_3 = Glare(
    Name="Temp",
    RhinoScene=False,
    Sky=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,
    Run=False,
    BooleanValue_0=False,
    BooleanValue_1=False,
    BooleanValue_10=False,
    BooleanValue_11=False,
    BooleanValue_12=False,
    BooleanValue_13=False,
    BooleanValue_14=False,
    BooleanValue_15=False,
    BooleanValue_16=False,
    BooleanValue_17=False,
    BooleanValue_18=False,
    BooleanValue_19=False,
    BooleanValue_2=False,
    BooleanValue_20=False,
    BooleanValue_3=False,
    BooleanValue_4=False,
    BooleanValue_5=False,
    BooleanValue_6=False,
    BooleanValue_7=False,
    BooleanValue_8=True,
    BooleanValue_9=False,
    Hidden_0=False,
    Hidden_1=False,
    Hidden_10=True,
    Hidden_11=True,
    Hidden_12=True,
    Hidden_13=True,
    Hidden_14=True,
    Hidden_15=True,
    Hidden_16=True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)  # -> Out, Pic, Image, Falsecolor, Evalglare, DGP, DGR
panel_4 = Panel(glare.Out)
image_scale = Panel(".75")
image_scale_2 = Panel(".75")
image_scale_3 = Panel(".75")
image_scale_4 = Panel(".75")
image_scale_5 = Panel(".75")
image_viewer = ImageViewer(ImagePath=visualization.Image, Scale=image_scale_2)
image_viewer_2 = ImageViewer(ImagePath=visualization.Falsecolor, Scale=image_scale_3)
image_viewer_3 = ImageViewer(ImagePath=visualization.Pic, Scale=image_scale)
image_viewer_4 = ImageViewer(ImagePath=glare.Image, Scale=image_scale_4)
image_viewer_5 = ImageViewer(ImagePath=glare.Falsecolor, Scale=image_scale_5)
